# Grasshopper definition image organization.gh (Grasshopper 1.0.7)

c_script = CSharpScript()  # -> out, A
# ---------- c_script: C# additional code ----------
  public static Random rnd = new Random();
  public static int maxIterations = 100;
  public static int iterations = 0;
  public static int sizeX;
  public static int sizeY;
  public static double plotSize;
  
  public static Input[] inputs;
  public static int numInputs;
  public static int numWeights;
  public static int numOfNodes;

  public static List<int> BMUs = new List<int>();
  public static List<Point3d> nodePts = new List<Point3d>();

  public static DataTree<double> inputW = new DataTree<double>();
  public static DataTree<double> nodeW = new DataTree<double>();

  public static void randomInputs()
  {
    inputs = new Input[numInputs];
    inputW.Clear();

    for(int i = 0; i < numInputs; i++)
    {
      inputs[i] = new Input(numWeights);

      for(int j = 0; j < numWeights; j++)
      {
        inputW.Add(inputs[i].weights[j], new GH_Path(i));
      }
    }
  }



  /////////////////////////
  //my classes

  public class Node
  {
    public double[] weights;
    public double x,y;

    public Node(int num, int _x, int _y)
    {
      x = _x;
      y = _y;

      weights = new double[num];

      for (int i = 0; i < weights.Length; i++)
      {
        weights[i] = rnd.NextDouble();
      }
    }
  }

  //////////////////////////////

  public class SOM
  {
    public Node[] nodes;
    public double radius;
    public double learningRate;
    public double timeConstant;
    public double radiusDecay;
    public double learningDecay;

    public SOM(int num, double learn)
    {
      if(sizeX >= sizeY)
      {
        radius = sizeX / 2;
      }
      else
      {
        radius = sizeY / 2;
      }

      learningRate = learn;

      nodes = new Node[numOfNodes];

      for (int i = 0; i < sizeX; i++)
      {
        for(int j = 0;j < sizeY;j++)
        {
          nodes[(i * sizeY) + j] = new Node(num, i, j);
        }
      }

      timeConstant = maxIterations / Math.Log(radius);
    }



    public int BMU(Input input)
    {
      int winner = -1;
      double min = sizeX + sizeY;

      for (int i = 0; i < nodes.Length; i++)
      {
        double dist = distance(nodes[i].weights, input.weights);

        if(dist < min)
        {
          min = dist;
          winner = i;
        }
      }

      BMUs.Add(winner);
      return winner;
    }

    
    public  void updateNodeWeights(Input inpt, int winner)
    {
      for(int i = 0; i < nodes.Length; i++)
      {
        for(int j = 0; j < numWeights; j++)
        {

          nodes[i].weights[j] += learningDecay * BMUInfluence(winner, i) * (inpt.weights[j] - nodes[i].weights[j]);
        }
      }
    }

    
    public double BMUInfluence(int winner, int id)
    {
      //difference here is geometrical
      double d = new Point3d(nodes[winner].x, nodes[winner].y, 0).
        DistanceTo(new Point3d(nodes[id].x, nodes[id].y, 0));

      double f = Math.Exp((-1 * Math.Pow(d, 2)) / (2 * Math.Pow(radiusDecay, 2)));
      return f;
    }



    public void TrainNodes(Input[] input)
    {
      learningDecay = learningRate * Math.Exp(-1 * iterations / timeConstant);
      radiusDecay = radius * Math.Exp(-1 * iterations / timeConstant);

      for(int i = 0; i < input.Length; i++)
      {
        int winner = BMU(input[i]);
        updateNodeWeights(input[i], winner);
      }
    }



    public void outputNodesXY ()
    {
      nodePts.Clear();

      for(int i = 0; i < numOfNodes; i++)
      {
        nodePts.Add(new Point3d(nodes[i].x * plotSize, nodes[i].y * plotSize, 0));
      }
    }



    public void outputNodesWeight ()
    {
      nodeW.Clear();

      for(int i = 0; i < numOfNodes; i++)
      {
        for(int j = 0; j < numWeights; j++)
        {
          nodeW.Add(nodes[i].weights[j], new GH_Path(i));
        }
      }
    }



    double distance(double [] x, double [] y)
    {
      double dist = 0.0;
      for(int i = 0; i < x.Length; i++)
      {
        dist += Math.Pow((x[i] - y[i]), 2);
      }
      dist = Math.Sqrt(dist);
      return dist;
    }

  }

  //////////////////////////////
  public class Input
  {
    public double[] weights;

    public  Input(int num)
    {
      weights = new double[num];

      for(int i = 0; i < num; i++)
      {
        weights[i] = rnd.NextDouble();
      }
    }

  }
# ---------- end c_script ----------
path = FilePath("C:\Users\Alexandra\Desktop\term2\MORPHOGENETIC\tulip_40_40.jpg")
colorgrid = CSharpScript(path=path, cellsize=Slider(3, range=0..10))  # -> out, A, B, C, D; inputs path: String, cellsize: Double
# ---------- colorgrid: C# usings ----------
using System.Drawing;
# ---------- colorgrid: C# ----------
    bitmap = new Bitmap(path);
    imgHeight = bitmap.Height;
    imgWidth = bitmap.Width;
    cellSize = cellsize;

    Grid grid = new Grid((int) imgWidth, (int) imgHeight);
    grid.Draw();

    A = grid.circles;
    B = grid.clrs;

    C = imgHeight;
    D = imgWidth;
# ---------- colorgrid: C# additional code ----------
  public static Bitmap bitmap;
  public int imgHeight;
  public int imgWidth;
  public static double cellSize;

  public class Cell
  {
    public int indexX;
    public int indexY;
    public double posX;
    public double posY;
    public Color color;
    public Circle c;
    public Point3d pt;

    public Cell(int indexX, int indexY)
    {
      this.indexX = indexX;
      this.indexY = indexY;
      this.posX = indexX * cellSize;
      this.posY = indexY * cellSize;
      this.color = bitmap.GetPixel(indexX, indexY);
    }

    public void Draw()
    {
      pt = new Point3d(posX, posY, 0);
      c = new Circle(new Point3d(posX, posY, 0), cellSize / 2);
    }

  }


  public class Grid
  {
    public int numX;
    public int numY;
    public Cell[][] cells;
    public List<Circle> circles;
    public List<Color> clrs;

    public Grid(int numX, int numY)
    {
      this.numX = numX;
      this.numY = numY;

      cells = new Cell[numX][];
      for (int i = 0; i < cells.Length; i++)
      {
        cells[i] = new Cell[numY];
        for (int j = 0; j < cells[i].Length; j++)
        {
          cells[i][j] = new Cell(i, j);
        }
      }
    }

    public void Draw()
    {
      circles = new List<Circle>();
      clrs = new List<Color>();
      for (int i = 0; i < cells.Length; i++)
      {
        for (int j = 0; j < cells[i].Length; j++)
        {
          cells[i][j].Draw();
          circles.Add(cells[i][j].c);
          clrs.Add(cells[i][j].color);
        }
      }

    }

  }
# ---------- end colorgrid ----------
path_2 = FilePath("C:\Users\Alexandra\Desktop\term2\MORPHOGENETIC\pieces of code\summer.jpg")
preview = CustomPreview(Geometry=colorgrid.A, Material=colorgrid.B)
panel = Panel(colorgrid.out)

path_3 = FilePath("C:\Users\Alexandra\Desktop\term2\MORPHOGENETIC\pieces of code\ring2.jpg")
timer = Timer(TimerInterval=20, Target=kmeans)  # disabled
kmeans = CSharpScript(R=Button(), size=Slider(1, range=0..10), path=path_3, k=Slider(4, range=0..10))  # -> out, A, B, C, D, E, F, G; inputs R: Boolean, size: Double, path: String, k: Int32
# ---------- kmeans: C# ----------
    if(R)
    {
      //setup image
      bitmap = new Bitmap(path);
      imgHeight = bitmap.Height;
      imgWidth = bitmap.Width;
      cellSize = size;
      image = new Image((int) imgWidth, (int) imgHeight);
      image.Draw();

      clusters = new ClusterGroup(k, image.cells);
      inputPoints = image.pts;
      inputs = image.cells;
      clusters.AssignClusters();
    }

    clusters.UpdateClusters();


    A = image.pts;
    B = image.clrs;
    C = clusters.DrawClusterPts();

    D = clusters.centroids[0].assignedPts;
    E = clusters.centroids[1].assignedPts;
    F = clusters.centroids[2].assignedPts;
    G = clusters.centroids[3].assignedPts;




    //  E = clusters.centroids[0].colorVec;
# ---------- kmeans: C# additional code ----------
  public static Random rnd = new Random();
  public static Bitmap bitmap;
  public static int imgHeight;
  public static int imgWidth;
  public static double cellSize;
  public static Image image;
  public static List<Point3d> inputPoints;
  public static Cell[] inputs;

  public  ClusterGroup clusters;
  public static DataTree<Point3d> outputTree = new DataTree<Point3d>();


  ////////////////////////////////////////////

  public class Cluster
  {
    public Point3d centroid;
    public List<Cell> assignedInputs;
    public List<Point3d> assignedPts;

    public Vector3d colorVec;

    public Cluster(Point3d pt)
    {
      this.centroid = pt;
      Color clr = bitmap.GetPixel((int) centroid.X, (int) centroid.Y);
      this.colorVec = new Vector3d(clr.R, clr.G, clr.B);
      this.assignedInputs = new List<Cell>();
      this.assignedPts = new List<Point3d>();
    }

    public void MeanVector()
    {
      double r = 0.0;
      double g = 0.0;
      double b = 0.0;

      for (int i = 0; i < assignedInputs.Count; i++)
      {
        r += assignedInputs[i].color.R;
        g += assignedInputs[i].color.G;
        b += assignedInputs[i].color.B;
      }

      r /= assignedInputs.Count;
      g /= assignedInputs.Count;
      b /= assignedInputs.Count;
      colorVec = new Vector3d(r, g, b);
    }

  }

  ///////////////////////////////////////////////

  public class ClusterGroup
  {
    public int K;
    public Cluster[] centroids;
    Cell[] inputs;

    public ClusterGroup(int K, Cell[] inputs)
    {
      this.K = K;

      this.centroids = new Cluster[K];
      for (int i = 0; i < centroids.Length; i++)
      {
        Point3d pt = new Point3d(1.0 * rnd.Next(imgWidth), 1.0 * rnd.Next(imgHeight), 0);
        centroids[i] = new Cluster(pt);
      }

      this.inputs = inputs;
    }

    public List<Point3d> DrawClusterPts()
    {
      List<Point3d> pts = new List<Point3d>();
      for (int i = 0; i < centroids.Length; i++)
      {
        pts.Add(centroids[i].centroid);
      }
      return pts;
    }

    public void AssignClusters()
    {
      for (int i = 0; i < inputs.Length; i++)
      {
        double minDist = double.MaxValue;
        int winner = -1;

        for (int j = 0; j < centroids.Length; j++)
        {
          double d = distance(centroids[j], inputs[i]);

          if(d < minDist)
          {
            minDist = d;
            winner = j;
          }
        }

        centroids[winner].assignedInputs.Add(inputs[i]);
        centroids[winner].assignedPts.Add(inputs[i].pt);
      }
    }

    public void UpdateClusters()
    {
      for (int i = 0; i < centroids.Length; i++)
      {
        centroids[i].MeanVector();
        AssignClusters();
      }

    }
  }

  /////////////////////////////////////////////

  public static double distance(Cluster cluster, Cell input)
  {
    double d = Math.Pow(cluster.colorVec.X - input.color.R, 2)
      + Math.Pow(cluster.colorVec.Y - input.color.G, 2)
      + Math.Pow(cluster.colorVec.Z - input.color.B, 2);

    return Math.Sqrt(d);
  }



  ////////////////////////////////////////////////

  public class Cell
  {
    public int indexX;
    public int indexY;
    public double posX;
    public double posY;
    public Color color;
    public Point3d pt;
    public double[] weights;

    public Cell(int indexX, int indexY)
    {
      this.indexX = indexX;
      this.indexY = indexY;
      this.posX = indexX * cellSize;
      this.posY = indexY * cellSize;
      this.color = bitmap.GetPixel(indexX, indexY);

      this.weights = new double[3];
      this.weights[0] = this.color.R;
      this.weights[1] = this.color.G;
      this.weights[2] = this.color.B;

    }

    public void Draw()
    {
      pt = new Point3d(posX, posY, 0);
    }

  }

  //////////////////////////////////////////////////////

  public class Image
  {
    public int numX;
    public int numY;
    public  Cell[] cells;
    public List<Color> clrs;
    public List<Point3d> pts;


    public Image(int numX, int numY)
    {
      this.numX = numX;
      this.numY = numY;

      cells = new Cell[numX * numY];
      for (int i = 0; i < numX; i++)
      {

        for (int j = 0; j < numY; j++)
        {
          cells[i * numY + j] = new Cell(i, j);
        }
      }
    }

    public void Draw()
    {
      clrs = new List<Color>();
      pts = new List<Point3d>();
      for (int i = 0; i < numX; i++)
      {
        for (int j = 0; j < numY; j++)
        {
          cells[i * numY + j].Draw();
          clrs.Add(cells[i * numY + j].color);
          pts.Add(cells[i * numY + j].pt);
        }
      }

    }
  }

  //////////////////////////////////////////
# ---------- end kmeans ----------
pt = Point(kmeans.C)  # disabled
preview_2 = CustomPreview(Geometry=kmeans.A, Material=kmeans.B)
preview_3 = CustomPreview(Geometry=kmeans.G, Material=ColourSwatch(SwatchColor=RGB(150, 8, 139)))
preview_4 = CustomPreview(Geometry=kmeans.D, Material=ColourSwatch(SwatchColor=RGB(214, 39, 173)))
preview_5 = CustomPreview(Geometry=kmeans.E, Material=ColourSwatch(SwatchColor=RGB(219, 209, 15)))
preview_6 = CustomPreview(Geometry=kmeans.F, Material=ColourSwatch(SwatchColor=RGB(141, 90, 250)))

path_4 = FilePath("C:\Users\Alexandra\Desktop\kilimi_small.jpg")
timer_2 = Timer(TimerInterval=20, Target=c_script_2)  # disabled
c_script_2 = CSharpScript(R=Button(), size=Slider(1, range=0..10), path=path_4)  # -> out, A, B, C, D, E; inputs R: Boolean, size: Double, path: String
# ---------- c_script_2: C# ----------
    if(init == true || R == true)
    {
      bitmap = new Bitmap(path);
      imgHeight = bitmap.Height;
      imgWidth = bitmap.Width;
      cellSize = size;

      grid = new Grid((int) imgWidth, (int) imgHeight);
      grid.Draw();

      sizeX = grid.numX;
      sizeY = grid.numY;
      cellSize = size;

      numInputs = grid.numX * grid.numY;
      numWeights = 3;
      numOfNodes = sizeX * sizeY;

      iterations = 1;

      //instantiate the SOM
      som = new SOM(3, 0.1);
      //output SOM's location
      //this doesn't change so only needs to happen once
      som.outputNodesXY();

      init = false;
      R = false;
    }


    //train the SOM
    BMUs.Clear();
    som.TrainNodes(grid.cells);
    //update the number of iterations
    iterations++;

    //output SOM's weights
    som.outputNodesWeight();

    //A = rects;
    A = nodePts;
    B = nodeW;
    C = inputW;
    D = BMUs;
    E = grid.circles;
# ---------- c_script_2: C# additional code ----------
  public static Bitmap bitmap;
  public int imgHeight;
  public int imgWidth;
  public static double cellSize;
  Grid grid;

  public static Random rnd = new Random();
  public static bool init = true;

  public static int maxIterations = 100;
  public static int iterations = 0;
  public static int sizeX;
  public static int sizeY;

  public static int numInputs;
  public static int numWeights;
  public static int numOfNodes;
  public static SOM som;

  public static List<int> BMUs = new List<int>();
  public static List<Point3d> nodePts = new List<Point3d>();

  public static DataTree<double> inputW = new DataTree<double>();
  public static DataTree<double> nodeW = new DataTree<double>();

  /////////////////////////
  //my classes

  //for the starting random nodes of the som
  public class Node
  {
    public double[] weights;
    public double x,y;

    public Node(int num, int _x, int _y)
    {
      x = _x;
      y = _y;

      weights = new double[num];

      for (int i = 0; i < weights.Length; i++)
      {
        weights[i] = rnd.Next(256);
      }
    }
  }

  //////////////////////////////

  public class SOM
  {
    public Node[] nodes;
    public double radius;
    public double learningRate;
    public double timeConstant;
    public double radiusDecay;
    public double learningDecay;

    public SOM(int num, double learn)
    {
      if(sizeX >= sizeY)
      {
        radius = sizeX / 2;
      }
      else
      {
        radius = sizeY / 2;
      }

      learningRate = learn;

      nodes = new Node[numOfNodes];

      for (int i = 0; i < sizeX; i++)
      {
        for(int j = 0;j < sizeY;j++)
        {
          nodes[(i * sizeY) + j] = new Node(num, i, j);
        }
      }

      timeConstant = maxIterations / Math.Log(radius);
    }



    public int BMU(Cell input)
    {
      int winner = -1;
      double min = double.MaxValue;

      for (int i = 0; i < nodes.Length; i++)
      {
        double dist = distance(nodes[i].weights, input.weights);

        if(dist < min)
        {
          min = dist;
          winner = i;
        }
      }

      BMUs.Add(winner);
      return winner;
    }


    public  void updateNodeWeights(Cell inpt, int winner)
    {
      for(int i = 0; i < nodes.Length; i++)
      {
        for(int j = 0; j < numWeights; j++)
        {
          nodes[i].weights[j] += learningDecay * BMUInfluence(winner, i) * (inpt.weights[j] - nodes[i].weights[j]);
        }
      }
    }


    public double BMUInfluence(int winner, int id)
    {

      double d = new Point3d(nodes[winner].x, nodes[winner].y, 0).
        DistanceTo(new Point3d(nodes[id].x, nodes[id].y, 0));

      double f = Math.Exp((-1 * Math.Pow(d, 2)) / (2 * Math.Pow(radiusDecay, 2)));
      return f;
    }



    public void TrainNodes(Cell[] input)
    {
      learningDecay = learningRate * Math.Exp(-1 * iterations / timeConstant);
      radiusDecay = radius * Math.Exp(-1 * iterations / timeConstant);

      for(int i = 0; i < input.Length; i++)
      {
        int winner = BMU(input[i]);
        updateNodeWeights(input[i], winner);
      }
    }



    public void outputNodesXY ()
    {
      nodePts.Clear();

      for(int i = 0; i < numOfNodes; i++)
      {
        nodePts.Add(new Point3d(nodes[i].x * cellSize, nodes[i].y * cellSize, 0));
      }
    }



    public void outputNodesWeight ()
    {
      nodeW.Clear();

      for(int i = 0; i < numOfNodes; i++)
      {
        for(int j = 0; j < numWeights; j++)
        {
          nodeW.Add(nodes[i].weights[j], new GH_Path(i));
        }
      }
    }


    //the "distance" between the vectors of colors
    double distance(double [] x, double [] y)
    {
      double dist = 0.0;
      for(int i = 0; i < x.Length; i++)
      {
        dist += Math.Pow((x[i] - y[i]), 2);
      }
      dist = Math.Sqrt(dist);
      return dist;
    }

  }

  public class Cell
  {
    public int indexX;
    public int indexY;
    public double posX;
    public double posY;
    public Color color;
    public Circle c;
    public Point3d pt;
    public double[] weights;

    public Cell(int indexX, int indexY)
    {
      this.indexX = indexX;
      this.indexY = indexY;
      this.posX = indexX * cellSize;
      this.posY = indexY * cellSize;
      this.color = bitmap.GetPixel(indexX, indexY);

      this.weights = new double[3];
      this.weights[0] = this.color.R;
      this.weights[1] = this.color.G;
      this.weights[2] = this.color.B;

    }

    public void Draw()
    {
      pt = new Point3d(posX, posY, 0);
      c = new Circle(new Point3d(posX, posY, 0), cellSize / 2);
    }

  }


  public class Grid
  {
    public int numX;
    public int numY;
    public Cell[] cells;
    public List<Circle> circles;
    public List<Color> clrs;

    public Grid(int numX, int numY)
    {
      this.numX = numX;
      this.numY = numY;

      cells = new Cell[numX * numY];
      for (int i = 0; i < numX; i++)
      {

        for (int j = 0; j < numY; j++)
        {
          cells[i * numY + j] = new Cell(i, j);

        }
      }

      for (int i = 0; i < cells.Length; i++)
      {
        for (int k = 0; k < 3; k++)
        {
          inputW.Add(cells[i].weights[k], new GH_Path(i));
        }
      }
    }

    public void Draw()
    {
      circles = new List<Circle>();
      clrs = new List<Color>();
      for (int i = 0; i < numX; i++)
      {
        for (int j = 0; j < numY; j++)
        {
          cells[i * numY + j].Draw();
          circles.Add(cells[i * numY + j].c);
          clrs.Add(cells[i * numY + j].color);
        }
      }

    }

  }
# ---------- end c_script_2 ----------
item = ListItem(List=c_script_2.B, Index=0, Wrap=True)  # -> Item, Item1, Item2, Item3

path_5 = FilePath("C:\Users\Alexandra\Desktop\term2\MORPHOGENETIC\pieces of code\ring2.jpg")
timer_3 = Timer(TimerInterval=20, Target=kmeans_2)  # disabled
kmeans_2 = CSharpScript(R=Button(), size=Slider(1, range=0..10), path=path_5, k=Slider(4, range=0..10))  # -> out, A, B, C, D, E, F, G; inputs R: Boolean, size: Double, path: String, k: Int32; same code as kmeans
pt_2 = Point(kmeans_2.C)  # disabled
preview_7 = CustomPreview(Geometry=kmeans_2.A, Material=kmeans_2.B)
preview_8 = CustomPreview(Geometry=kmeans_2.G, Material=ColourSwatch(SwatchColor=RGB(150, 8, 139)))
preview_9 = CustomPreview(Geometry=kmeans_2.D, Material=ColourSwatch(SwatchColor=RGB(214, 39, 173)))
preview_10 = CustomPreview(Geometry=kmeans_2.E, Material=ColourSwatch(SwatchColor=RGB(219, 209, 15)))
preview_11 = CustomPreview(Geometry=kmeans_2.F, Material=ColourSwatch(SwatchColor=RGB(141, 90, 250)))

rgb = ColourRGB(Alpha=255, Red=item.Item3, Green=item.Item1, Blue=item.Item2)  # -> flatten(Colour)
pt_3 = Point(c_script_2.A)
panel_2 = Panel(pt_3)
panel_3 = Panel(rgb)
number_slider = Slider(0.4, range=0..1)
number_slider_2 = Slider(1, range=0..1)
box = CenterBox(Base=pt_3, X=number_slider, Y=number_slider, Z=number_slider)
mbox = MeshBox(Base=box, XCount=number_slider_2, YCount=number_slider_2, ZCount=number_slider_2)
preview_12 = CustomPreview(Geometry=mbox, Material=panel_3)
